# Grasshopper definition SampleV1.gh (Grasshopper 1.0.7)
# plug-ins: BabyPanda, Sasquatch

panel = Panel("""1
2
3""")
crv = Curve(<curve referenced from the Rhino model>)
number_slider = Slider(5, range=0..10)
panel_2 = Panel("""1

3""")
panel_3 = Panel("""1

3""")
pt = ConstructPoint(XCoordinate=0, YCoordinate=0, ZCoordinate=0)
null = Null(Count=1)
geo = Geometry(pt)
null_2 = Null(Count=1)
entwine = Entwine(Branch00=Slider(1, range=0..1), Branch01=null, Branch02=Slider(0, range=0..1), FlattenInputs=True)  # -> flatten(Result)
entwine_2 = Entwine(Branch00=geo, Branch01=null_2, Branch02=geo, FlattenInputs=True)  # -> flatten(Result)
oxlwb = OpenXlWorkbook(Filename="TestBook1.xlsx", TryGrabExisting=True, TryWrite=True, ShowWindow=True)  # disabled
cdf1 = CreateDataframeV1(Col1=entwine, Col2=panel_2, X=<missing>, Y=entwine_2)
cdf = CreateDataframe(Col1_Int=entwine, Col2_Double=panel_3, Col3_String=entwine_2, Col4_Point3d=entwine_2)
rdf = ReadDataframe(State=0)
vec = VectorXYZ(XComponent=0, YComponent=0, ZComponent=0)  # -> Vector, Length
rtxlwb = ReadTableFromXlWorkbook(XlWorkbook=oxlwb, TableName="Table5")
df = DataFrame(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)
pdecon = Deconstruct()  # -> XComponent, YComponent, ZComponent
ppdf = PrettyPrintDataframe(DataFrame=df)
df_2 = DataFrame(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)
panel_4 = Panel(ppdf)
