# Grasshopper definition SvgTest.gh (Grasshopper 1.0.7)
# plug-ins: BabyPanda

panel = Panel("C:\Users\nniem\OneDrive - Ramboll\Documents\Scrap\testSvg.svg")
crv = Curve([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])
panel_2 = Panel("""#1
#2""")
crv_2 = Curve(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)
cssvg = CreateSynopticSvg(
    SvgFilepath=panel,
    SPRegionCurve=crv,
    SPRegionId=panel_2,
    SPRegionSubcategory=panel_2,
    BackgroundCurve=crv_2,
    BackgroundThickness="2",
    BackgroundColour=ColourSwatch(SwatchColor=RGB(65, 44, 255)),
    Write=Toggle(False))
