# Grasshopper definition TestCanvasV2.gh (Grasshopper 1.0.7)
# plug-ins: GrasshopperDataAnalysis, BabyPanda

panel = Panel("""1
2
3""")
panel_2 = Panel("""1
2
3""")
pt = ConstructPoint(XCoordinate=0, YCoordinate=0, ZCoordinate=0)
geo = Geometry(pt)
crv = Curve(<curve referenced from the Rhino model>)
num = Number(panel_2)
cdf = CreateDataframe(Col1=panel, Col2=num, X=Slider(5, range=0..10), Y=geo)
cdf_2 = CreateDataframe(Col1=panel, Col2=geo, X=geo)
df = DataFrame(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)
df_2 = DataFrame(cdf_2)
ppdf = PrettyPrintDataframe(DataFrame=df_2)
rdf = ReadDataframe(DataFrame=cdf, State=2)  # -> Col1, Col2, X, Y
ppdf_2 = PrettyPrintDataframe(DataFrame=df)
rdf_2 = ReadDataframe(DataFrame=cdf_2, State=0)
panel_3 = Panel(ppdf_2)
rdf_3 = ReadDataframe(State=2)  # -> Col1, Col2
