# Grasshopper definition TestCanvasV3.gh (Grasshopper 1.0.7)
# plug-ins: BabyPanda

panel = Panel("""1
2
3""")
panel_2 = Panel("""1
2
3""")
pt = ConstructPoint(XCoordinate=0, YCoordinate=0, ZCoordinate=0)
geo = Geometry(pt)
crv = Curve(<curve referenced from the Rhino model>)
num = Number(panel_2)
cdf = CreateDataframe(Col1=panel, Col2=num, X=Slider(5, range=0..10), Y=geo)
df = DataFrame(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)
oxlwb = OpenXlWorkbook(Filename="TestBook1.xlsx", TryGrabExisting=True, TryWrite=True, ShowWindow=True)
c_bp = CSharpScriptWBP(
    DF=cdf,
    Reference=["C:\Users\nniem\source\repos\BabyPanda\BabyPanda.GH\bin\Debug\net48\Microsoft.Data.Analysis.dll", "C:\Users\nniem\source\repos\BabyPanda\BabyPanda.GH\bin\Debug\net48\BabyPanda.dll"])  # -> out, A
# ---------- c_bp: C# usings ----------
using Microsoft.Data.Analysis;
using BabyPanda;
# ---------- c_bp: C# ----------
    DataFrameColumn col = DF["Col1"];
# ---------- end c_bp ----------
rdf = ReadDataframe(DataFrame=cdf, State=0)  # -> Col1, Col2, X, Y
ppdf = PrettyPrintDataframe(DataFrame=df)
rtxlwb = ReadTableFromXlWorkbook(XlWorkbook=oxlwb, TableName="Table5")
panel_3 = Panel(ppdf)
df_2 = DataFrame(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)
