# Grasshopper definition TestCanvasV4.gh (Grasshopper 1.0.7)
# plug-ins: BabyPanda, Sasquatch

panel = Panel("""1
2
3""")
pt = ConstructPoint(XCoordinate=0, YCoordinate=0, ZCoordinate=0)
geo = Geometry(pt)
null = Null(Count=1)
crv = Curve(<curve referenced from the Rhino model>)
number_slider = Slider(5, range=0..10)
panel_2 = Panel("""1

3""")
panel_3 = Panel("""1
2
3""")
pt_2 = ConstructPoint(XCoordinate=0, YCoordinate=0, ZCoordinate=0)
entwine = Entwine(Branch00=geo, Branch01=null, Branch02=geo, FlattenInputs=True)  # -> flatten(Result)
geo_2 = Geometry(pt_2)
null_2 = Null(Count=1)
num = Number(panel_3)
entwine_2 = Entwine(Branch00=geo_2, Branch01=null_2, Branch02=geo_2, FlattenInputs=True)  # -> flatten(Result)
cdf = CreateDataframe(Col1=panel_2, Col2=num, X=entwine_2, Y=entwine_2)
oxlwb = OpenXlWorkbook(Filename="TestBook1.xlsx", TryGrabExisting=True, TryWrite=True, ShowWindow=True)
df = DataFrame(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)
vec = VectorXYZ(XComponent=0, YComponent=0, ZComponent=0)  # -> Vector, Length
rdf = ReadDataframe(DataFrame=cdf, State=0)  # -> Col1, Col2, X, Y
rtxlwb = ReadTableFromXlWorkbook(XlWorkbook=oxlwb, TableName="Table5")
ppdf = PrettyPrintDataframe(DataFrame=df)
panel_4 = Panel(rdf.Y)
panel_5 = Panel(ppdf)
pdecon = Deconstruct()  # -> XComponent, YComponent, ZComponent
df_2 = DataFrame(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)
