# Grasshopper definition TestCanvasV8.gh (Grasshopper 1.0.7)
# plug-ins: BabyPanda, Sasquatch

panel = Panel("""1
2
3""")
crv = Curve(<curve referenced from the Rhino model>)
number_slider = Slider(5, range=0..10)
panel_2 = Panel("""1

3""")
panel_3 = Panel("""1

3""")
pt = ConstructPoint(XCoordinate=0, YCoordinate=0, ZCoordinate=0)
null = Null(Count=1)
geo = Geometry(pt)
null_2 = Null(Count=1)
entwine = Entwine(Branch00=Slider(1, range=0..1), Branch01=null, Branch02=Slider(0, range=0..1), FlattenInputs=True)  # -> flatten(Result)
num = Number(panel_3)
entwine_2 = Entwine(Branch00=geo, Branch01=null_2, Branch02=geo, FlattenInputs=True)  # -> flatten(Result)
vec = VectorXYZ(XComponent=0, YComponent=0, ZComponent=0)  # -> Vector, Length
oxlwb = OpenXlWorkbook(Filename="TestBook1.xlsx", TryGrabExisting=True, TryWrite=True, ShowWindow=True)  # disabled
cdf = CreateDataframe(Col1=entwine, Col2=panel_2, X=entwine_2, Y=entwine_2)
rdf = ReadDataframe(DataFrame=cdf, State=0)  # -> Col1, Col2, X, Y
df = DataFrame(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)
rtxlwb = ReadTableFromXlWorkbook(XlWorkbook=oxlwb, TableName="Table5")
panel_4 = Panel(rdf.Col1)
panel_5 = Panel(rdf.Y)
pdecon = Deconstruct()  # -> XComponent, YComponent, ZComponent
ppdf = PrettyPrintDataframe(DataFrame=df)
df_2 = DataFrame(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)
panel_6 = Panel(ppdf)
